# Grasshopper definition pattern.gh (Grasshopper 0.9.75)
# plug-ins: ClipperComponents

# ---- group: Patch parameters
width = Slider(3, range=0.5..5)
number_of_points = Slider(140, range=5..500)
random_seed = Slider(-1, range=-10..10)

# ---- group: Points on patch, unrolled from cylinder, thus repeating
width_2 = Data(width)
number_of_points_2 = Data(number_of_points)
random_seed_2 = Data(random_seed)
expression = Expression(w=width_2, Expression="w/2/pi")
xz = XZPlane(Origin=Point(0, 0, 0))
cyl = Cylinder(Base=xz, Radius=expression, Length=-1)
popgeo = PopulateGeometry(Geometry=cyl, Count=number_of_points_2, Seed=random_seed_2)
pdecon = Deconstruct(Point=popgeo)  # -> XComponent, YComponent, ZComponent
project = Project(Geometry=popgeo, Plane=xz)  # -> Geometry, Transform
polar = ToPolar(Point=project.Geometry, System=PlaneXY(0, 0, 0), AnglePoleDown=True)  # -> Phi, Theta, Radius
expression_2 = Expression(w=width_2, P=polar.Phi, T=polar.Theta, Expression="w * (T + P) / 2 / pi")
pt = ConstructPoint(XCoordinate=expression_2, YCoordinate=pdecon.YComponent, ZCoordinate=0)
center_point = Data(pt)

# ---- group: Repeat patch twice
center_point_2 = Data(center_point)
width_3 = Data(width)
vec = VectorXYZ(XComponent=width_3, YComponent=0, ZComponent=0)  # -> Vector, Length
arrlinear = LinearArray(Geometry=center_point_2, Direction=vec.Vector, Count=3)  # -> Geometry, Transform
rev = Reverse(Vector=vec.Vector)
flatten = FlattenTree(Tree=arrlinear.Geometry, Path="{0}")
move = Move(Geometry=flatten, Motion=rev)  # -> Geometry, Transform
cell_center = Data(move.Geometry)

# ---- group: Offset distance dependent on Y
cell_center_2 = Data(cell_center)
pdecon_2 = Deconstruct(Point=cell_center_2)  # -> XComponent, YComponent, ZComponent
graph = GraphMapper(
    pdecon_2.YComponent,
    x0=0,
    x1=1,
    y0=0,
    y1=1,
    container_name="Bezier",
    cpx=[0, 0.8623521328, 1, 1],
    cpy=[0, 0, 0.6532256603, 1])
dom = ConstructDomain(DomainStart=Slider(0.014, range=0..1), DomainEnd=Slider(0.079, range=0..1))
remap = RemapNumbers(Value=graph, Source=Domain(0, 1), Target=dom)  # -> Mapped, Clipped
offset_distance = Data(remap.Mapped)

# ---- group: Voronoy cells from points
cell_center_3 = Data(cell_center)
width_4 = Data(width)
expression_3 = Expression(w=width_4, Expression="2*w")
neg = Negative(Value=width_4)
dom_2 = ConstructDomain(DomainStart=neg, DomainEnd=expression_3)
rectangle = Rectangle(Plane=PlaneXY(0, 0, 0), XSize=dom_2, YSize=Domain(0, 1), Radius=0)  # -> Rectangle, Length
voronoi = Voronoi(Points=cell_center_3, Boundary=rectangle.Rectangle, BruteForceOverride=False)
cell = Data(voronoi)

# ---- group: Select cells in center rectangle
cell_center_4 = Data(cell_center)
cell_2 = Data(cell)
width_5 = Data(width)
offset_distance_2 = Data(offset_distance)
dom_3 = ConstructDomain(DomainStart="0", DomainEnd=width_5)
rectangle_2 = Rectangle(Plane=PlaneXY(0, 0, 0), XSize=dom_3, YSize=Domain(0, 1), Radius=0)  # -> Rectangle, Length
incurve = PointInCurve(Point=cell_center_4, Curve=rectangle_2.Rectangle)  # -> Relationship, Point
equals = Equality(FirstNumber=incurve.Relationship, SecondNumber="0")  # -> Equality, Inequality
dispatch = Dispatch(List=offset_distance_2, DispatchPattern=equals.Inequality)  # -> ListA, ListB
dispatch_2 = Dispatch(List=cell_2, DispatchPattern=equals.Inequality)  # -> ListA, ListB
offset_distance_3 = Data(dispatch.ListA)
cell_3 = Data(dispatch_2.ListA)

# ---- group: Offset cells
offset_distance_4 = Data(offset_distance_3)
cell_4 = Data(cell_3)
graft = GraftTree(Tree=offset_distance_4, IncludeEmptyLists=True, IncludeNullItems=True)
graft_2 = GraftTree(Tree=cell_4, IncludeEmptyLists=True, IncludeNullItems=True)
polyoffset = PolylineOffset(
    Polylines=graft_2,
    Distance=graft,
    Plane=Plane(origin=(0, 0, 0), x=(0, 0, 0), y=(0, 0, 0)),
    Tolerance=0.001,
    ClosedFillet=2,
    OpenFillet=1,
    Miter=2)  # -> Contour, Holes
flatten_2 = FlattenTree(Tree=polyoffset.Holes, Path="{0}")
pattern = Data(flatten_2)

# ----
crv = Curve(pattern)
